vi "Function.gviweb"   [G Web Development Software 22.3.0]
panel controls:
  "url": string
  "stop": bool
panel indicators:
  "headers": string
  "body": string
uses:
  NI::HTTP::Open HTTP Handle.gvi
  NI::HTTP::GET.gvi
  NI::HTTP::Close HTTP Handle.gvi
diagram:
  while {
    call "Open HTTP Handle.gvi"() -> (client handle out=w1, error out=w2)
    call "GET.gvi"(client handle=w1, url=$url, error in=w2) -> (client handle out=w3, headers=w4, body=w5, error out=w6)
    $headers <- w4
    call "Close HTTP Handle.gvi"(client handle=w3, error in=w6)
    $body <- w5
    stop if $stop
  }
