vi "index.gviweb"   [G Web Development Software 22.3.0]
panel controls:
  "Exit": bool
  "🔘 PUSH BUTTON (NO/NC)": T1 = {"LED7"=TRUE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}
  "Tab Control": i32
  "WS Address": string = "ws://192.168.1.100:8765 "
  "Join Path": string = "{\r\n    \"role\":\"web\",\r\n    \"id\":\"GWeb\"\r\n}"
panel indicators:
  "Display <Replace Me>": string
  "Websocket Data": string
  "websocket session out": u32
  "INDICATOR PANEL": T2
  "Data Json": T4
  "Timestamp": timestamp
  "🌡TEMPERATURE MONITORING (°C)": f64
  "PCR Logo": string
  "💧 HUMIDITY MONITORING (%RH)": f64
  "WebSocket": bool
  "Revpi Status": bool
  "🌡 Temperature": f64
  "💧 Humidity": f64
  "🌡 RTD PT100": f64
  "⚡ Analog Input": f64
  "📡 Object Detected": f64
  "LED": bool
  "URL Image": string
  "TOTAL INPUT": i32
  "URL Image_2": string
  "EMERGENCY STATUS": string
  "TOTAL ANALOG INPUT": i32
  "🌡 Temperature (MD02)": f64
  "💧 Humidity (MD02)": f64
  "〰 SIGNAL GENERATOR (mA)": f64
  "🌡RTD PT100 (°C)": f64
types:
  T1 = cluster{"BUZZ1": bool, "BUZZ2": bool, "BUZZ3": bool, "LED1": bool, "LED2": bool, "LED3": bool, "LED4": bool, "LED5": bool, "LED6": bool, "LED7": bool, "LED8": bool, "SW 12": bool, "SW 13": bool, "📡 PROXIMITY SENSOR (DI 14)": bool}
  T2 = cluster{"LED1": bool, "LED2": bool, "LED3": bool, "LED4": bool, "BUZZ1": bool, "LED6": bool, "LED7": bool, "BUZZ2": bool, "BUZZ3": bool, "LED5": bool, "LED8": bool, "FAN ": bool, "LAMP": bool, "MOTOR": bool}
  T3 = cluster{"BUZZ1": bool, "BUZZ2": bool, "BUZZ3": bool, "LED1": bool, "LED2": bool, "LED3": bool, "LED4": bool, "LED5": bool, "LED6": bool, "LED7": bool, "LED8": bool, "FAN": bool, "LAMP": bool, "MOTOR": bool}
  T4 = cluster{"path": string, "HUM": f64, "TEMP": f64, "ANALOG": f64, "RTD": f64, "LED": T3}
  T5 = cluster{"Web Socket URL": string, "Base URL": string, "WebSocket Data": string, "data": T4}
uses:
  WebApp::support::Message Queue::Create All Message Queues.gvi
  WebApp::support::Message Queue::Dequeue Message.gvi
  WebApp::support::Message Queue::Enqueue Message (Single).gvi
  NI::WebSockets::Write String.gvi
  WebApp::support::Simple Display Error.gvi
  NI::G Core::Error::Build Error Cluster.gvi
  WebApp::support::Error Handler - Message Handling Loop.gvi
  NI::WebSockets::Open WebSocket.gvi
  NI::WebSockets::Read String.gvi
  NI::WebSockets::Close WebSocket.gvi
  WebApp::support::Error Handler - Event Handling Loop.gvi
  WebApp::support::Parse Json.gvi
  WebApp::support::Record Message.gviweb
diagram:
  w1 = bool FALSE  # Stop Event
  Create User Event[EventName="Stop Event"](user event data type=w1) -> (error out=w2, user event out=w3)
  call "Create All Message Queues.gvi"(error in=w2) -> (message queues=w4, error out=w5)
  w6 = cluster{"Ws Ref": i32, "Display": string} {all zero or empty}
  Property Node(instance in=w4) -> ("UI"=w7)
  s1 = w6  # shift register
  while {
    call "Dequeue Message.gvi"(message queue in=w7, error in=w5) -> (message queue out=w8, message=w9, message data=w10, error out=w11)
    # s1: Data
    # w3: Stop Event
    case (w9) ignore case {  # Message Cases
      frame "Initialize" {
        Property Node(instance in=s1, "Display"="Initial Message") -> (instance out=w13)
        call "Enqueue Message (Single).gvi"(message queue in=w8, message="Update Display", message data="Initial Message", error in=w11) -> (error out=w12)
        w14 = default
      }
      frame "Control" {
        Property Node(instance in=s1, "Ws Ref"=$"websocket session out") -> (instance out=w13)
        $"INDICATOR PANEL" <- $"🔘 PUSH BUTTON (NO/NC)"
        call "Enqueue Message (Single).gvi"(message queue in=w8, message="Update Display", message data="Send Control", error in=w11) -> (error out=w15)
        Flatten To Json(anything=$"🔘 PUSH BUTTON (NO/NC)") -> (JSON string=w16, error out=w17)
        call "Write String.gvi"(websocket session in=$"websocket session out", string message=w16) -> (error out=w18)
        Merge Errors(w18, w15, w17) -> (error out=w12)
        w14 = default
      }
      frame "Update Display" {
        Variant To Data(error in (no error)=w11, type=string "", variant=w10) -> (data=w19, error out=w12)
        $"Display <Replace Me>" <- w19
        w13 = s1
        w14 = default
      }
      frame "Error" {
        Variant To Data(error in (no error)=w11, type=no error, variant=w10) -> (data=w20, error out=w12)
        call "Simple Display Error.gvi"(error In=w20)
        w13 = s1
        w14 = default
      }
      frame "---Copy This Frame---" {
        Merge Errors(w11) -> (error out=w12)
        w13 = s1
        w14 = default
      }
      frame "Exit" {
        Release Queue(error in=w11, queue=w8) -> (error out=w21)
        # #CodeNeeded - Add any required cleanup code here. Note that if 'Exit' was called as a result of an error, an error dialog will be displayed. Add any custom error handling for an 'Exit' condition here as well.
        Generate User Event(event data=TRUE, user event=w3) -> (error out=w22)
        # Release the message queue reference
        Merge Errors(w21, w22) -> (error out=w12)
        # Stop the VI
        w13 = s1
        w14 = TRUE
      }
      frame Default {
        w23 = "The invalid message string \"%s\" was received in the Message Handling Loop."
        Format Into String(formatString=w23, w9) -> w24
        call "Build Error Cluster.gvi"(code=1, description=w24, error in=w11) -> (error out=w12)
        w13 = s1
        w14 = default
      }
    }
    call "Error Handler - Message Handling Loop.gvi"(message queue in=w8, error in=w12) -> (dup error in=w25)
    next s1 = w13
    stop if w14
  }
  s2 = "Initialize"  # shift register
  s3 = uninitialised  # shift register
  while {
    # s2: State
    # s3: WS Ref
    # w3: Stop Event
    case (s2) {
      frame Default {
        w30 = "The invalid message string \"%s\" was received in the Message Handling Loop."
        Format Into String(formatString=w30, s2) -> w31
        call "Build Error Cluster.gvi"(code=1, description=w31) -> (error out=w29)
        w26 = 0
        w27 = "Exit"
        w28 = TRUE
      }
      frame "Initialize" {
        call "Open WebSocket.gvi"(url=$"WS Address") -> (websocket session out=w26, error out=w29)
        $"websocket session out" <- w26
        w27 = "Join"
        w28 = default
      }
      frame "Join" {
        call "Write String.gvi"(websocket session in=s3, string message=$"Join Path") -> (websocket session out=w26, error out=w29)
        w27 = "Read WebSocket"
        w28 = default
      }
      frame "Read WebSocket" {
        # Send data to loop websocket
        call "Read String.gvi"(websocket session in=s3) -> (websocket session out=w26, string response=w32, error out=w29)
        Select(s=w29, t="Exit", f="Read WebSocket") -> w27
        $"Websocket Data" <- w32
        w28 = default
      }
      frame "Exit" {
        call "Close WebSocket.gvi"(websocket session in=s3) -> (error out=w29)
        Generate User Event(event data=TRUE, user event=w3)
        w26 = s3
        w27 = "Exit"
        w28 = TRUE
      }
    }
    next s2 = w27
    next s3 = w26
    stop if w28
  }
  Register For Events("Stop Event"=w3) -> (event registration refnum out=w33)
  s4 = w33  # shift register
  while {
    event (dynamic events = s4) {
      on "🔘 PUSH BUTTON (NO/NC)" Value changed {
        call "Enqueue Message (Single).gvi"(message queue in=w7, message="Control") -> (message queue out=w36, error out=w35)
        w34 = default
      }
      on "Exit" Value changed {
        call "Enqueue Message (Single).gvi"(priority message=TRUE, message queue in=w7, message="Exit") -> (message queue out=w36, error out=w35)
        w34 = $Exit
      }
      on dynamic event 0 {
        $"Display <Replace Me>" <- "\"Exit\" button pressed"
        w34 = TRUE
        w35 = default
        w36 = w7
      }
    }
    call "Error Handler - Event Handling Loop.gvi"(message queue in=w36, error in=w35) -> (dup error in=w37)
    stop if w34
  }
  Unregister For Events(error in=w37, event registration refnum=s4) -> (error out=w38)
  Merge Errors(w38, w25, w29) -> (error out=w39)
  Destroy User Event(error in=w39, user event=w3)
  s5 = T5 {all zero or empty}  # shift register
  s6 = "Initialize"  # shift register
  while {
    # WebSocket Loop, This loop run by itself to ensure sent data by websocket always received
    # w3: Stop Event
    # s5: Data
    case (s6) {
      frame Default {
        Wait(time to wait=50)
        w44 = "The invalid message string \"%s\" was received in the Message Handling Loop."
        Format Into String(formatString=w44, s6) -> w45
        # Wrong case selector name
        call "Build Error Cluster.gvi"(code=1, description=w45) -> (error out=w41)
        w40 = default
        w42 = s5
        w43 = "Exit"
      }
      frame "Initialize" {
        # Initiialize step only done when first running this panel
        w40 = default
        w41 = default
        w42 = s5
        w43 = "WebSocket Data"
      }
      frame "WebSocket Data" {
        Property Node(instance in=s5) -> ("WebSocket Data"=w46, instance out=w47)
        Property Node(instance in=w47, "WebSocket Data"=$"Websocket Data") -> (instance out=w42)
        # This Tab is used to Receive Data from WebSocket and send it to other state
        # Wait until thereis data in Websocket Data terminal
        Wait(time to wait=50)
        Is Equal(x=w46, y=$"Websocket Data") -> w48
        # If it's the same data there is no need to proceed into display
        Is Empty String Or Path(string/path=$"Websocket Data") -> w49
        Logical Or(w48, w49) -> w50
        # Read data from loop websocket and check if there is data
        Select(s=w50, t="WebSocket Data", f="Data Parse") -> w43
        w40 = default
        w41 = default
      }
      frame "Data Parse" {
        Property Node(instance in=s5) -> ("WebSocket Data"=w51, instance out=w52)
        call "Parse Json.gvi"(Data In=w51) -> (Data Out=w53, Error Out=w54)
        # This Tab is used to Receive Data from WebSocket and send it to other state
        Property Node(instance in=w52, "data"=w53) -> (instance out=w42)
        call "Record Message.gviweb"(Message=w51, Direction="In", Error In=w54) -> (Error Out=w41)
        w40 = default
        w43 = "Indicator"
      }
      frame "Indicator" {
        Property Node(instance in=s5) -> ("data"=w55, "data:LED"=w56, "data:TEMP"=w57, "data:HUM"=w58, "data:ANALOG"=w59, "data:RTD"=w60, instance out=w42)
        $"Data Json" <- w55
        $"🔘 PUSH BUTTON (NO/NC)" <- w56
        $"🌡 Temperature (MD02)" <- w57
        $"INDICATOR PANEL" <- w56
        $"🌡 Temperature" <- w57
        $"🌡TEMPERATURE MONITORING (°C)" <- w57
        $"💧 HUMIDITY MONITORING (%RH)" <- w58
        $"💧 Humidity (MD02)" <- w58
        $"💧 Humidity" <- w58
        $"🌡 RTD PT100" <- w59
        $"〰 SIGNAL GENERATOR (mA)" <- w59
        $"⚡ Analog Input" <- w60
        $"🌡RTD PT100 (°C)" <- w60
        w40 = default
        w41 = default
        w43 = "WebSocket Data"
      }
      frame "Exit" {
        Generate User Event(event data=TRUE, user event=w3) -> (error out=w41)
        # Exit, run once on changing panels (IFrames)
        w40 = TRUE
        w42 = s5
        w43 = "Exit"
      }
    }
    $"Revpi Status" <- TRUE
    Get Current Time() -> (current time=w61)
    $Timestamp <- w61
    $"EMERGENCY STATUS" <- "SAFE(NORMAL)"
    $"TOTAL ANALOG INPUT" <- 4
    $"TOTAL INPUT" <- 14
    $WebSocket <- TRUE
    next s5 = w42
    next s6 = w43
    stop if w40
  }
