vi "Create All Message Queues.gvi"   [LabVIEW NXG 6.0.0]
# This VI creates and initializes all the message queues for your application. If your application requires more than one message queue, right-click the "Message Queues" constant above and select Open Type Def.  Add the new Message Queue(s) to the type definition, then initialize them in this VI.
inputs:
  "error in": error
outputs:
  "message queues": "All Message Queues.gtype"
  "error out": error
types:
  "All Message Queues.gtype" = cluster{"UI": Queue<"Message Cluster.gtype">}
uses:
  WebApp::support::Message Queue::Obtain Message Queue.gvi
  WebApp::support::Message Queue::Enqueue Message (Single).gvi
diagram:
  # This VI creates and initializes all the message queues for your application. If your application requires more than one message queue, right-click the "Message Queues" constant above and select Open Type Def.  Add the new Message Queue(s) to the type definition, then initialize them in this VI.
  case ($"error in") {
    frame No Error {
      call "Obtain Message Queue.gvi"(error in=$"error in") -> (message queue=w3, error out=w4)
      Property Node(instance in="All Message Queues.gtype" {all zero or empty}, "UI"=w3) -> (instance out=w2)
      call "Enqueue Message (Single).gvi"(message queue in=w3, message="Initialize", error in=w4) -> (error out=w1)
    }
    frame Error {
      w1 = $"error in"
      w2 = default
    }
  }
  $"message queues" <- w2
  $"error out" <- w1
