vi "Parse Json.gvi"   [G Web Development Software 22.3.0]
inputs:
  "Data In": string
  "Error In": error
outputs:
  "Data Out": T2
  "Error Out": error
types:
  T1 = cluster{"BUZZ1": bool, "BUZZ2": bool, "BUZZ3": bool, "LED1": bool, "LED2": bool, "LED3": bool, "LED4": bool, "LED5": bool, "LED6": bool, "LED7": bool, "LED8": bool, "FAN": bool, "LAMP": bool, "MOTOR": bool}
  T2 = cluster{"path": string, "hum": f64, "temp": f64, "analog": f64, "rtd": f64, "LED": T1}
  T3 = cluster{"path": string, "hum": f64, "temp": f64, "rtd": f64, "analog": f64, "LED": T1}
diagram:
  Unflatten From Json(JSON string=$"Data In", path=["type"], type and defaults=string "")
  Unflatten From Json(JSON string=$"Data In", path=["path"], type and defaults=string "") -> (value=w1)
  Unflatten From Json(JSON string=$"Data In", path=["HUM"], type and defaults=f64 0) -> (value=w2)
  Unflatten From Json(JSON string=$"Data In", path=["TEMP"], type and defaults=f64 0) -> (value=w3)
  Unflatten From Json(JSON string=$"Data In", path=["RTD"], type and defaults=f64 0) -> (value=w4)
  Unflatten From Json(JSON string=$"Data In", error in (no error)=$"Error In", path=["ANALOG"], type and defaults=f64 0) -> (error out=w5, value=w6)
  Unflatten From Json(JSON string=$"Data In", path=["LED8"], type and defaults=bool FALSE) -> (value=w7)
  Unflatten From Json(JSON string=$"Data In", path=["FAN"], type and defaults=bool FALSE) -> (value=w8)
  Unflatten From Json(JSON string=$"Data In", path=["LAMP"], type and defaults=bool FALSE) -> (value=w9)
  Unflatten From Json(JSON string=$"Data In", path=["MOTOR"], type and defaults=bool FALSE) -> (value=w10)
  # {"type": "data", "from": "('127.0.0.1', 59411)", "path": "/sensor/temp", "message": 1111}
  # {"type": "join_path", "status": "joined", "path": "/sensor/temp"}
  # {"type": "ping_host", "status": "ok", "ping": 0.21}
  Unflatten From Json(JSON string=$"Data In", path=["BUZZ1"], type and defaults=bool FALSE) -> (value=w11)
  Unflatten From Json(JSON string=$"Data In", path=["BUZZ2"], type and defaults=bool FALSE) -> (value=w12)
  Unflatten From Json(JSON string=$"Data In", path=["BUZZ3"], type and defaults=bool FALSE) -> (value=w13)
  Unflatten From Json(JSON string=$"Data In", path=["LED3"], type and defaults=bool FALSE) -> (value=w14)
  Unflatten From Json(JSON string=$"Data In", path=["LED4"], type and defaults=bool FALSE) -> (value=w15)
  Unflatten From Json(JSON string=$"Data In", path=["LED5"], type and defaults=bool FALSE) -> (value=w16)
  Unflatten From Json(JSON string=$"Data In", path=["LED6"], type and defaults=bool FALSE) -> (value=w17)
  Unflatten From Json(JSON string=$"Data In", path=["LED7"], type and defaults=bool FALSE) -> (value=w18)
  Unflatten From Json(JSON string=$"Data In", path=["LED1"], type and defaults=bool FALSE) -> (value=w19)
  Unflatten From Json(JSON string=$"Data In", path=["LED2"], type and defaults=bool FALSE) -> (value=w20)
  Property Node(instance in=T1 {all zero or empty}, "BUZZ1"=w11, "BUZZ2"=w12, "BUZZ3"=w13, "LED1"=w19, "LED2"=w20, "LED3"=w14, "LED4"=w15, "LED5"=w16, "LED6"=w17, "LED7"=w18, "LED8"=w7, "FAN"=w8, "LAMP"=w9, "MOTOR"=w10) -> (instance out=w21)
  Property Node(instance in=T3 {all zero or empty}, "LED"=w21, "path"=w1, "hum"=w2, "temp"=w3, "rtd"=w4, "analog"=w6) -> (instance out=w22)
  $"Data Out" <- w22
  $"Error Out" <- w5
