vi "Record Message.gviweb"   [G Web Development Software 22.3.0]
inputs:
  "Messages reference": "DataGrid reference"
  "Message": string
  "Direction": string
  "Reset?": bool
  "Error In": error
outputs:
  "Messages": T1[]
  "Error Out": error
types:
  T1 = cluster{"Direction": string, "Time": string, "Message": string}
diagram:
  case ($"Error In") {
    frame Error, Default {
      w1 = $"Error In"
    }
    frame No Error {
      s1 = uninitialised  # shift register
      s2 = uninitialised  # shift register
      while {
        Select(s=$"Reset?", t=$"Messages reference", f=s2) -> w2
        Initialize Array(element=T1 {all zero or empty}) -> w3
        Get Current Time() -> (current time=w4)
        Format Into String(w4) -> w5
        Property Node(instance in=T1 {all zero or empty}, "Direction"=$Direction, "Message"=$Message, "Time"=w5) -> (instance out=w6)
        Build Array(w6, s1) -> w7
        Select(s=$"Reset?", t=w3, f=w7) -> w8
        Array Subset(array=w8, length0=20) -> w9
        next s1 = w9
        next s2 = w2
        stop if TRUE
      }
      Property Node(instance in=s2, "Value"=s1, error in=$"Error In") -> (error out=w1)
      $Messages <- s1
    }
  }
  $"Error Out" <- w1
